# Grasshopper definition ShopBot 5-Axis tooplaths and simulation with trunnion.gh (Grasshopper 0.9.66)
# plug-ins: Firefly

sample_resolution = Slider(2, range=0.5..10)
mesh = Mesh(<mesh referenced from the Rhino model>)
slcie_start_height = Slider(10, range=0..10)
stepover = Slider(2, range=1..10)
bbox = BoundingBox(Content=mesh, Plane=PlaneXY(0, 0, 0))  # -> Box, Box_2
debrep = DeconstructBrep(Brep=bbox.Box)  # -> Faces, Edges, Vertices
item = ListItem(List=debrep.Edges, Index=Slider(8, range=0..10), Wrap=True)
item_2 = ListItem(List=debrep.Faces, Index=Slider(4, range=0..10), Wrap=True)
area = Area(Geometry=item_2)  # -> Area, Centroid
len = Length(Curve=item)
division = Division(A=len, B=stepover)
xy = XYPlane(Origin=area.Centroid)
round = Round(Number=division)  # -> Nearest, Floor, Ceiling
series = Series(Start=slcie_start_height, Step=stepover, Count=round.Floor)
# pyramid based slice dircetions?
# 
# additional sub toolpath spawning based on contour distance?
Z = UnitZ(Factor=series)
move = Move(Geometry=xy, Motion=Z)  # -> Geometry, Transform
sec = MeshPlane(Mesh=mesh, Plane=move.Geometry)
lng = ListLength(List=sec)
larger = LargerThan(FirstNumber=lng, SecondNumber=Slider(1, range=0..1))  # -> LargerThan, OrEqualTo
dispatch = Dispatch(List=sec, DispatchPattern=larger.LargerThan)  # -> ListA, ListB
lng_2 = ListLength(List=dispatch.ListA)
larger_2 = LargerThan(FirstNumber=lng_2, SecondNumber=Slider(2, range=0..2))  # -> LargerThan, OrEqualTo
dispatch_2 = Dispatch(List=dispatch.ListA, DispatchPattern=larger_2.LargerThan)  # -> ListA, ListB
crv = Curve(dispatch.ListA)
crv_2 = Curve(dispatch_2.ListA)
item_3 = ListItem(List=crv, Index=1, Wrap=True)
item_4 = ListItem(List=crv, Index=0, Wrap=True)
item_5 = ListItem(List=crv_2, Index=1, Wrap=True)
item_6 = ListItem(List=crv_2, Index=2, Wrap=True)
crvprox = CurveProximity(CurveA=item_4, CurveB=item_3)  # -> PointA, PointB, Distance
crvprox_2 = CurveProximity(CurveA=item_5, CurveB=item_6)  # -> PointA, PointB, Distance
number_slider = Slider(0.1, range=0..0.1)
number_slider_2 = Slider(0.218, range=0..1)
ln = Line(StartPoint=crvprox.PointA, EndPoint=crvprox.PointB)
ln_2 = Line(StartPoint=crvprox_2.PointA, EndPoint=crvprox_2.PointB)
crv_3 = Curve(<curve referenced from the Rhino model>)
crv_4 = Curve(sec)
brep = Brep(<brep referenced from the Rhino model>)
ext = ExtendCurve(Curve=ln, Type=0, Start=number_slider, End=number_slider)
neg = Negative(Value=number_slider_2)
ext_2 = ExtendCurve(Curve=ln_2, Type=0, Start=number_slider, End=number_slider)
divdist = DivideDistance(Curve=crv_3, Distance=Slider(3, range=0..10))  # -> Points, Tangents, Parameters
neg_2 = Negative(Value=number_slider_2)
divlength = DivideLength(Curve=flatten(crv_4), Length=sample_resolution)  # -> Points, Tangents, Parameters
volume = Volume(Geometry=brep)  # -> Volume, Centroid
number_slider_3 = Slider(1954, range=0..10000)
mesh_object = BooleanToggle(True)
meshcp = MeshClosestPoint(Point=divlength.Points, Mesh=mesh)  # -> Point, Index, Parameter
animator = Slider(0.626, range=0..1)
offset = Offset(Curve=ext, Distance=number_slider_2, Plane=PlaneXY(0, 0, 0), Corners=1)
offset_2 = Offset(Curve=ext, Distance=neg, Plane=PlaneXY(0, 0, 0), Corners=1)
brep_2 = Brep([<brep referenced from the Rhino model> x2])
# fix union of path slices with bridges
offset_3 = Offset(Curve=ext_2, Distance=number_slider_2, Plane=PlaneXY(0, 0, 0), Corners=1)
pt = Point(divdist.Points)
mesh_2 = Mesh(mesh)
offset_4 = Offset(Curve=ext_2, Distance=neg_2, Plane=PlaneXY(0, 0, 0), Corners=1)
timer = Timer(TimerInterval=10, Target=fader2)
srf = Surface(<surface referenced from the Rhino model>)
fader2 = FaderTwoWay(
    MinimumValue=Slider(0, range=0..100),
    MaximumValue=Slider(995, range=0..1000),
    FadeOut=Slider(1632, range=0..60000),
    FadeIn=Slider(16073, range=0..120000),
    DelayOut=number_slider_3,
    DelayIn=number_slider_3)  # -> FadingOutput, LoopCounter
meval = MeshEval(Mesh=mesh, Parameter=meshcp.Parameter)  # -> Point, Normal, Colour
srf_cp = SurfaceClosestPoint(Point=pt, Surface=srf)  # -> Point, UVPoint, Distance
filter = StreamFilter(Gate=mesh_object, Stream0=brep_2, Stream1=mesh_2)
Z_2 = UnitZ(Factor=1)
crv_5 = Curve(dispatch.ListA)
pl = PlaneNormal(Origin=meval.Point, ZAxis=meval.Normal)
srf_2 = Surface(<surface referenced from the Rhino model>)
evalsrf = EvaluateSurface(Surface=srf, Point=srf_cp.UVPoint)  # -> Point, Normal, Frame
align = AlignPlane(Plane=pl, Direction=Z_2)  # -> Plane, Angle
division_2 = Division(A=fader2.FadingOutput, B=Slider(1000, range=0..1000))
area_2 = Area(Geometry=srf_2)  # -> Area, Centroid
runion = RegionUnion()
panel = Panel(division_2)
srf_cp_2 = SurfaceClosestPoint(Point=area_2.Centroid, Surface=srf_2)  # -> Point, UVPoint, Distance
deplane = DeconstructPlane(Plane=align.Plane)  # -> Origin, XAxis, YAxis, ZAxis
num = Number(animator)
evalsrf_2 = EvaluateSurface(Surface=srf_2, Point=srf_cp_2.UVPoint)  # -> Point, Normal, Frame
rev = Reverse(Vector=deplane.YAxis)
pl_2 = ConstructPlane(Origin=deplane.Origin, XAxis=rev, YAxis=deplane.XAxis)
object_platfrom_plane = Plane(evalsrf_2.Frame)
tool_planes = Plane(flatten(pl_2))
lng_3 = ListLength(List=tool_planes)
multiplication = Multiplication(A=lng_3, B=num)
item_7 = ListItem(List=tool_planes, Index=multiplication, Wrap=True)
xy_2 = XYPlane(Origin=Point(0, 0, 0))
srf_3 = Surface(<surface referenced from the Rhino model>)
tool_plane = Plane(item_7)
plane_for_collision_checking = Plane(tool_plane)
mesh_for_collsion_detection = Mesh(mesh_2)
pln = Plane(xy_2)
area_3 = Area(Geometry=srf_3)  # -> Area, Centroid
tool_plane_corrected = Plane(tool_plane)
deplane_2 = DeconstructPlane(Plane=PlaneXY(0, 0, 0))  # -> Origin, XAxis, YAxis, ZAxis
srf_cp_3 = SurfaceClosestPoint(Point=area_3.Centroid, Surface=srf_3)  # -> Point, UVPoint, Distance
pl_3 = ConstructPlane(Origin=deplane_2.Origin, XAxis=deplane_2.ZAxis, YAxis=deplane_2.YAxis)
deplane_3 = DeconstructPlane(Plane=tool_plane_corrected)  # -> Origin, XAxis, YAxis, ZAxis
evalsrf_3 = EvaluateSurface(Surface=srf_3, Point=srf_cp_3.UVPoint)  # -> Point, Normal, Frame
position_plane = Plane(evalsrf_3.Frame)

move_2 = Move(Geometry=deplane_3.Origin, Motion=deplane_3.ZAxis)  # -> Geometry, Transform
xy_3 = XYPlane(Origin=deplane_3.Origin)
cp = PlaneClosestPoint(Point=move_2.Geometry, Plane=xy_3)  # -> Point, UVPoint, Distance
number_slider_4 = Slider(4, range=0..10)
vec2pt = Vector2Pt(PointA=deplane_3.Origin, PointB=cp.Point, Unitize=False)  # -> Vector, Length
Z_3 = UnitZ(Factor=1)
pl_4 = ConstructPlane(Origin=deplane_3.Origin, XAxis=vec2pt.Vector, YAxis=Z_3)
amp = Amplitude(Vector=deplane_3.YAxis, Amplitude=number_slider_4)
rev_2 = Reverse(Vector=amp)
move_3 = Move(Geometry=deplane_3.Origin, Motion=rev_2)  # -> Geometry, Transform
cir = Circle(Plane=pl_4, Radius=number_slider_4)
crv_cp = CurveClosestPoint(Point=move_3.Geometry, Curve=cir)  # -> Point, Parameter, Distance
len_2 = Length(Curve=cir)
num_2 = Number(len_2)
division_3 = Division(A=Slider(360, range=0..1000), B=num_2)
multiplication_2 = Multiplication(A=division_3, B=crv_cp.Parameter)
panel_2 = Panel(multiplication_2)

xy_4 = XYPlane(Origin=deplane_3.Origin)
rev_3 = Reverse(Vector=deplane_3.XAxis)
larger_3 = LargerThan(FirstNumber=panel_2, SecondNumber=Slider(180, range=0..1000))  # -> LargerThan, OrEqualTo
number_slider_5 = Slider(4, range=0..10)
filter_2 = StreamFilter(Gate=larger_3.OrEqualTo, Stream0=deplane_3.XAxis, Stream1=rev_3)
amp_2 = Amplitude(Vector=filter_2, Amplitude=number_slider_5)
cir_2 = Circle(Plane=xy_4, Radius=number_slider_5)
move_4 = Move(Geometry=deplane_3.Origin, Motion=amp_2)  # -> Geometry, Transform
len_3 = Length(Curve=cir_2)
crv_cp_2 = CurveClosestPoint(Point=move_4.Geometry, Curve=cir_2)  # -> Point, Parameter, Distance
num_3 = Number(len_3)
division_4 = Division(A=Slider(360, range=0..1000), B=num_3)
multiplication_3 = Multiplication(A=division_4, B=crv_cp_2.Parameter)
panel_3 = Panel(multiplication_3)
addition = Addition(A=panel_3, B=Slider(270, range=0..1000))
subtraction = Subtraction(A=Slider(360, range=0..1000), B=addition)

jagged = SettingsSpeed()
deplane_4 = DeconstructPlane(Plane=position_plane)  # -> Origin, XAxis, YAxis, ZAxis

# ---- group: Rotation X axis
yz = YZPlane(Origin=deplane_4.Origin)
X = UnitX(Factor=1)
align_2 = AlignPlane(Plane=position_plane, Direction=X)  # -> Plane, Angle
number_slider_6 = Slider(4, range=0..10)
deplane_5 = DeconstructPlane(Plane=align_2.Plane)  # -> Origin, XAxis, YAxis, ZAxis
amp_3 = Amplitude(Vector=deplane_5.YAxis, Amplitude=number_slider_6)
move_5 = Move(Geometry=deplane_4.Origin, Motion=amp_3)  # -> Geometry, Transform
cir_3 = Circle(Plane=yz, Radius=number_slider_6)
crv_cp_3 = CurveClosestPoint(Point=move_5.Geometry, Curve=cir_3)  # -> Point, Parameter, Distance
len_4 = Length(Curve=cir_3)
num_4 = Number(len_4)
division_5 = Division(A=Slider(360, range=0..1000), B=num_4)
multiplication_4 = Multiplication(A=division_5, B=crv_cp_3.Parameter)
panel_4 = Panel(multiplication_4)

# ---- group: Rotation Z axis
X_2 = UnitX(Factor=1)
number_slider_7 = Slider(4, range=0..10)
align_3 = AlignPlane(Plane=position_plane, Direction=X_2)  # -> Plane, Angle
amp_4 = Amplitude(Vector=deplane_4.YAxis, Amplitude=number_slider_7)
cir_4 = Circle(Plane=align_3.Plane, Radius=number_slider_7)
move_6 = Move(Geometry=deplane_4.Origin, Motion=amp_4)  # -> Geometry, Transform
crv_cp_4 = CurveClosestPoint(Point=move_6.Geometry, Curve=cir_4)  # -> Point, Parameter, Distance
len_5 = Length(Curve=cir_4)
num_5 = Number(len_5)
division_6 = Division(A=Slider(360, range=0..1000), B=num_5)
multiplication_5 = Multiplication(A=division_6, B=crv_cp_4.Parameter)
panel_5 = Panel(multiplication_5)

# ----
deplane_6 = DeconstructPlane(Plane=plane_for_collision_checking)  # -> Origin, XAxis, YAxis, ZAxis
pl_5 = ConstructPlane(Origin=deplane_6.Origin, XAxis=deplane_6.ZAxis, YAxis=deplane_6.YAxis)
number_distance = Slider(16, range=0..100)
number_size = Slider(7, range=0..100)
number_slider_8 = Slider(44, range=0..100)
number_slider_9 = Slider(55, range=0..100)
number_slider_10 = Slider(121, range=0..1000)
number_slider_11 = Slider(7, range=0..100)
number_slider_12 = Slider(45, range=0..1000)
a_axis_angle = Slider(66, range=-90..90)
b_axis_angle = Slider(56, range=0..360)
spindle_height_half = Slider(95, range=0..1000)
bit_radius = Slider(5, range=0..100)
num_6 = Number(bit_radius)
amp_5 = Amplitude(Vector=deplane_2.ZAxis, Amplitude=num_6)
move_7 = Move(Geometry=pl_3, Motion=amp_5)  # -> Geometry, Transform
chuck_radius = Slider(22, range=0..100)
spindle_widt_half = Slider(35, range=0..100)
safety_cone_radius = Number(spindle_widt_half)
multiplication_6 = Multiplication(A=safety_cone_radius, B=Slider(1.1, range=0..10))
stem_radius = Slider(17, range=0..100)
bit_lenght = Slider(80, range=0..100)
chuck_height = Slider(20, range=0..100)
stem_height = Slider(18, range=0..100)
swatch = ColourSwatch(SwatchColor=RGB(3, 3, 3))
xy_5 = XYPlane(Origin=Point(0, 0, 0))
material = CreateMaterial(
    Diffuse=ColourSwatch(SwatchColor=RGB(252, 141, 193)),
    Specular=RGB(255, 255, 255),
    Emission=RGB(0, 0, 0),
    Transparency=Slider(0.53, range=0..1),
    Shine=0)
xy_6 = XYPlane(Origin=Point(0, 0, 0))
material_2 = CreateMaterial(
    Diffuse=ColourSwatch(SwatchColor=RGB(141, 195, 252)),
    Specular=RGB(255, 255, 255),
    Emission=RGB(0, 0, 0),
    Transparency=Slider(0.32, range=0..1),
    Shine=0)
multiplication_7 = Multiplication(A=number_slider_11, B=Slider(4, range=0..10))
pln_2 = Plane(xy_5)
a_axis_angle_2 = Number(panel_2)
b_axis_angle_2 = Number(subtraction)
neg_3 = Negative(Value=multiplication_7)
yz_2 = YZPlane(Origin=Point(0, 0, 0))
cyl = Cylinder(Base=yz_2, Radius=number_slider_8, Length=number_slider_9)
Z_4 = UnitZ(Factor=neg_3)
deplane_7 = DeconstructPlane(Plane=pln_2)  # -> Origin, XAxis, YAxis, ZAxis
cyl_2 = Cylinder(Base=pln_2, Radius=bit_radius, Length=bit_lenght)
cyl_3 = Cylinder(Base=pln_2, Radius=chuck_radius, Length=chuck_height)
cyl_4 = Cylinder(Base=pln_2, Radius=stem_radius, Length=stem_height)
cap = CapHoles(Brep=cyl)
box = CenterBox(Base=pln_2, X=spindle_widt_half, Y=spindle_widt_half, Z=spindle_height_half)
X_3 = UnitX(Factor=number_slider_10)
cap_2 = CapHoles(Brep=cyl_2)
cap_3 = CapHoles(Brep=cyl_3)
cap_4 = CapHoles(Brep=cyl_4)
move_8 = Move(Geometry=cap, Motion=X_3)  # -> Geometry, Transform
box_2 = CenterBox(Base=xy_6, X=number_slider_10, Y=number_slider_12, Z=number_slider_11)
addition_2 = Addition(A=bit_lenght, B=chuck_height)
mirror = Mirror(Geometry=move_8.Geometry, Plane=yz_2)  # -> Geometry, Transform
addition_3 = Addition(A=addition_2, B=stem_height)
safety_cone_lenght = Number(addition_3)
neg_4 = Negative(Value=safety_cone_lenght)
cone = Cone(Base=pln, Radius=multiplication_6, Length=neg_4)  # -> Cone, Tip
Z_5 = UnitZ(Factor=safety_cone_lenght)
move_9 = Move(Geometry=cone.Cone, Motion=Z_5)  # -> Geometry, Transform
mesh_3 = MeshBrep(Brep=move_9.Geometry, Settings=jagged)
orient = Orient(Geometry=mesh_3, Source=xy_2, Target=plane_for_collision_checking)  # -> Geometry, Transform
mmx = MeshMesh(MeshA=orient.Geometry, MeshB=mesh_for_collsion_detection, UseMeshMeshFast=True)
bbox_2 = BoundingBox(Content=mmx, Plane=PlaneXY(0, 0, 0))  # -> Box, Box_2
volume_2 = Volume(Geometry=bbox_2.Box)  # -> Volume, Centroid
sort = SortList(Keys=volume_2.Volume, ValuesA=volume_2.Centroid)  # -> Keys, ValuesA
rev_4 = ReverseList(List=sort.Keys)
rev_5 = ReverseList(List=sort.ValuesA)
item_8 = ListItem(List=rev_4, Index=0, Wrap=True)
item_9 = ListItem(List=rev_5, Index=0, Wrap=True)
# fix correction
# 
# should be based on width of impact area
smaller = SmallerThan(FirstNumber=item_8, SecondNumber=Slider(0.1, range=0..0.1))  # -> SmallerThan, OrEqualTo
vec2pt_2 = Vector2Pt(PointA=deplane_6.Origin, PointB=item_9, Unitize=False)  # -> Vector, Length
padjust = AdjustPlane(Plane=plane_for_collision_checking, Normal=vec2pt_2.Vector)
mirror_2 = Mirror(Geometry=padjust, Plane=pl_5)  # -> Geometry, Transform
deplane_8 = DeconstructPlane(Plane=mirror_2.Geometry)  # -> Origin, XAxis, YAxis, ZAxis
rev_6 = Reverse(Vector=deplane_8.XAxis)
pl_6 = ConstructPlane(Origin=deplane_8.Origin, XAxis=rev_6, YAxis=deplane_8.YAxis)
filter_3 = StreamFilter(Gate=smaller.SmallerThan, Stream0=orient.Geometry)
filter_4 = StreamFilter(Gate=smaller.SmallerThan, Stream0=pl_6, Stream1=plane_for_collision_checking)
corrected_plane = Plane(filter_4)
orient_2 = Orient(Geometry=mesh_3, Source=xy_2, Target=corrected_plane)  # -> Geometry, Transform
preview = CustomPreview(Geometry=filter_3, Shader=material)
preview_2 = CustomPreview(Geometry=orient_2.Geometry, Shader=material_2)
move_10 = Move(Geometry=box_2, Motion=Z_4)  # -> Geometry, Transform
addition_4 = Addition(A=addition_3, B=spindle_height_half)
rotate = Rotate(Geometry=move_10.Geometry, Angle=degrees(a_axis_angle_2), Plane=yz_2)  # -> Geometry, Transform
amp_6 = Amplitude(Vector=deplane_7.ZAxis, Amplitude=bit_lenght)
amp_7 = Amplitude(Vector=deplane_7.ZAxis, Amplitude=addition_2)
amp_8 = Amplitude(Vector=deplane_7.ZAxis, Amplitude=addition_4)
xy_7 = XYPlane(Origin=Point(0, 0, 0))
move_11 = Move(Geometry=cap_3, Motion=amp_6)  # -> Geometry, Transform
move_12 = Move(Geometry=cap_4, Motion=amp_7)  # -> Geometry, Transform
move_13 = Move(Geometry=box, Motion=amp_8)  # -> Geometry, Transform
rotate_2 = Rotate(Geometry=xy_7, Angle=degrees(a_axis_angle_2), Plane=yz_2)  # -> Geometry, Transform
deplane_9 = DeconstructPlane(Plane=rotate_2.Geometry)  # -> Origin, XAxis, YAxis, ZAxis
spindle_and_chuck_viz = Brep([move_11.Geometry, move_12.Geometry, move_13.Geometry])
millling_bit_viz = Brep(cap_2)
pln_3 = Plane(rotate_2.Geometry)
rotate_3 = Rotate(Geometry=pln_3, Angle=degrees(b_axis_angle_2), Plane=pln_3)  # -> Geometry, Transform
cyl_5 = Cylinder(Base=pln_3, Radius=number_slider_8, Length=number_slider_9)
addition_5 = Addition(A=number_slider_9, B=number_slider_11)
master_plane = Plane(rotate_3.Geometry)
cap_5 = CapHoles(Brep=cyl_5)
neg_5 = Negative(Value=addition_5)
number_slider_13 = Slider(100, range=0..100)
neg_6 = Negative(Value=number_slider_11)
deplane_10 = DeconstructPlane(Plane=master_plane)  # -> Origin, XAxis, YAxis, ZAxis
amp_9 = Amplitude(Vector=deplane_9.ZAxis, Amplitude=neg_5)
number_slider_14 = Slider(20, range=0..100)
addition_6 = Addition(A=chuck_radius, B=number_distance)
Z_6 = UnitZ(Factor=addition_2)
amp_10 = Amplitude(Vector=deplane_10.ZAxis, Amplitude=neg_6)
move_14 = Move(Geometry=cap_5, Motion=amp_9)  # -> Geometry, Transform
X_4 = UnitX(Factor=addition_6)
box_3 = CenterBox(Base=master_plane, X=number_slider_12, Y=number_slider_12, Z=number_slider_11)
move_15 = Move(Geometry=pln_2, Motion=Z_6)  # -> Geometry, Transform
amp_11 = Amplitude(Vector=deplane_10.XAxis, Amplitude=number_slider_14)
amp_12 = Amplitude(Vector=deplane_10.ZAxis, Amplitude=number_slider_13)
move_16 = Move(Geometry=box_3, Motion=amp_10)  # -> Geometry, Transform
cyl_6 = Cylinder(Base=master_plane, Radius=number_slider_14, Length=number_slider_13)  # disabled
move_17 = Move(Geometry=move_15.Geometry, Motion=X_4)  # -> Geometry, Transform
move_18 = Move(Geometry=deplane_10.Origin, Motion=amp_12)  # -> Geometry, Transform
deplane_11 = DeconstructPlane(Plane=tool_planes)  # -> Origin, XAxis, YAxis, ZAxis
move_19 = Move(Geometry=move_18.Geometry, Motion=amp_11)  # -> Geometry, Transform
pline = PolyLine(Vertices=deplane_11.Origin, Closed=False)
addition_7 = Addition(A=number_slider_10, B=number_slider_9)
multiplication_8 = Multiplication(A=number_size, B=Slider(2, range=0..10))
subtraction_2 = Subtraction(A=neg_5, B=number_distance)
orient_3 = Orient(Geometry=filter, Source=object_platfrom_plane, Target=master_plane)  # -> Geometry, Transform
orient_4 = Orient(Geometry=pline, Source=object_platfrom_plane, Target=master_plane)  # -> Geometry, Transform
orient_5 = Orient(Geometry=tool_plane_corrected, Source=object_platfrom_plane, Target=master_plane)  # -> Geometry, Transform
Y = UnitY(Factor=multiplication_8)
addition_8 = Addition(A=addition_7, B=number_distance)
amp_13 = Amplitude(Vector=deplane_9.ZAxis, Amplitude=subtraction_2)
motors = Brep([mirror.Geometry, move_8.Geometry, move_14.Geometry])
platforms = Brep([rotate.Geometry, move_16.Geometry])
deplane_12 = DeconstructPlane(Plane=orient_5.Geometry)  # -> Origin, XAxis, YAxis, ZAxis
X_5 = UnitX(Factor=addition_8)
rev_7 = Reverse(Vector=Y)
bit_xyz_position_point = Point(deplane_12.Origin)
vec2pt_3 = Vector2Pt(PointA=deplane_7.Origin, PointB=bit_xyz_position_point, Unitize=False)  # -> Vector, Length
move_20 = Move(Geometry=spindle_and_chuck_viz, Motion=vec2pt_3.Vector)  # -> Geometry, Transform
move_21 = Move(Geometry=millling_bit_viz, Motion=vec2pt_3.Vector)  # -> Geometry, Transform
item_10 = ListItem(List=move_20.Geometry, Index=0, Wrap=True)
item_11 = ListItem(List=move_20.Geometry, Index=[1, 2], Wrap=True)
pdecon = Deconstruct(Point=bit_xyz_position_point)  # -> XComponent, YComponent, ZComponent
vec2pt_4 = Vector2Pt(PointA=deplane_7.Origin, PointB=bit_xyz_position_point, Unitize=False)  # -> Vector, Length
move_22 = Move(Geometry=move_17.Geometry, Motion=vec2pt_4.Vector)  # -> Geometry, Transform
move_23 = Move(Geometry=deplane_9.Origin, Motion=amp_13)  # -> Geometry, Transform
move_24 = Move(Geometry=xy_6, Motion=X_5)  # -> Geometry, Transform
move_25 = Move(Geometry=move_22.Geometry, Motion=rev_7)  # -> Geometry, Transform
move_26 = Move(Geometry=move_22.Geometry, Motion=Y)  # -> Geometry, Transform
material_3 = CreateMaterial(
    Diffuse=ColourSwatch(SwatchColor=RGB(0, 225, 255)),
    Specular=RGB(255, 255, 255),
    Emission=RGB(0, 0, 0),
    Transparency=0,
    Shine=0)
xy_8 = XYPlane(Origin=move_23.Geometry)
material_4 = CreateMaterial(
    Diffuse=ColourSwatch(SwatchColor=RGB(19, 28, 125)),
    Specular=RGB(255, 255, 255),
    Emission=RGB(0, 0, 0),
    Transparency=0,
    Shine=0)
material_5 = CreateMaterial(
    Diffuse=ColourSwatch(SwatchColor=RGB(150, 150, 150)),
    Specular=RGB(255, 255, 255),
    Emission=RGB(0, 0, 0),
    Transparency=0,
    Shine=Slider(26, range=0..100))
material_6 = CreateMaterial(
    Diffuse=ColourSwatch(SwatchColor=RGB(92, 92, 92)),
    Specular=RGB(255, 255, 255),
    Emission=RGB(0, 0, 0),
    Transparency=0,
    Shine=Slider(6, range=0..100))
material_7 = CreateMaterial(
    Diffuse=ColourSwatch(SwatchColor=RGB(33, 33, 33)),
    Specular=RGB(255, 255, 255),
    Emission=RGB(0, 0, 0),
    Transparency=0,
    Shine=Slider(6, range=0..100))
material_8 = CreateMaterial(
    Diffuse=ColourSwatch(SwatchColor=RGB(92, 92, 92)),
    Specular=RGB(255, 255, 255),
    Emission=RGB(0, 0, 0),
    Transparency=0,
    Shine=Slider(6, range=0..100))
preview_3 = CustomPreview(Geometry=[orient_4.Geometry, pline], Shader=material_3)
tag = TextTag3D(Location=move_22.Geometry, Text=pdecon.YComponent, Size=number_size, Colour=swatch, Justification=7)
tag_2 = TextTag3D(Location=move_26.Geometry, Text=pdecon.XComponent, Size=number_size, Colour=swatch, Justification=7)
tag_3 = TextTag3D(Location=move_25.Geometry, Text=pdecon.ZComponent, Size=number_size, Colour=swatch, Justification=7)
preview_4 = CustomPreview(Geometry=platforms, Shader=material_4)
preview_5 = CustomPreview(Geometry=move_21.Geometry, Shader=material_5)
preview_6 = CustomPreview(Geometry=motors, Shader=material_6)
preview_7 = CustomPreview(Geometry=item_10, Shader=material_7)
preview_8 = CustomPreview(Geometry=item_11, Shader=material_8)
tag_4 = TextTag3D(
    Location=graft([move_24.Geometry, xy_8]),
    Text=graft([a_axis_angle_2, b_axis_angle_2]),
    Size=number_size,
    Colour=swatch,
    Justification=7)
