# Grasshopper definition gh shopbot code  adapting resultion - for 3D slicing mesh with high definition regions.gh (Grasshopper 0.9.66)

xz = XZPlane(Origin=Point(0, 0, 0))
cyl = Cylinder(Base=xz, Radius=0.5, Length=Slider(1, range=0..1))
pipeline = GeometryPipeline(
    GroupByLayer=False,
    GroupByType=False,
    IncludeHidden=True,
    IncludeLocked=True,
    LayerFilter="Region curves",
    NameFilter="*",
    TypeFilter=4)
scale = Scale(Geometry=cyl, Center=Point(0, 0, 0), Factor=Slider(79, range=0..100))  # -> Geometry, Transform
blend_curve_sample_resolution_factor = Slider(0.025, range=0.01..0.1)
deifintion_fade_factor = Slider(3.5, range=1..10)
curve_merge_length_factor = Slider(4.4, range=0..20)
curve_merge_bulge_factor = Slider(0.523, range=0..3)
mill_bit_sample_resolution = Slider(10, range=0..10)
runion = RegionUnion(Curves=pipeline)
miling_bit_diameter = Slider(6, range=0..10)
sampling_distance = Slider(0.5, range=0.5..10)
stepover_distance = Slider(1.3, range=0.5..10)
defintion_regions = Curve(runion)
safe_z = Slider(6, range=0..100)
brep = Brep(<brep referenced from the Rhino model>)
mesh = Mesh(<mesh referenced from the Rhino model>)
brep_2 = Brep(brep)
bbox = BoundingBox(Content=mesh, Plane=PlaneXY(0, 0, 0), UnionBox=True)  # -> Box, Box_2
debrep = DeconstructBrep(Brep=bbox.Box)  # -> Faces, Edges, Vertices
item = ListItem(List=debrep.Edges, Index=4, Wrap=True)
item_2 = ListItem(List=debrep.Vertices, Index=3, Wrap=True)
item_3 = ListItem(List=debrep.Vertices, Index=0, Wrap=True)
item_4 = ListItem(List=debrep.Vertices, Index=4, Wrap=True)
item_5 = ListItem(List=debrep.Faces, Index=4, Wrap=True)
len = Length(Curve=item)
multiplication = Multiplication(A=sampling_distance, B=blend_curve_sample_resolution_factor)
item_6 = ListItem(List=debrep.Edges, Index=9, Wrap=True)
pdecon = Deconstruct(Point=item_4)  # -> XComponent, YComponent, ZComponent
dist = Distance(PointA=item_3, PointB=item_2)
planar = Planar(Curve=item_5)  # -> Planar, Plane, Deviation
len_2 = Length(Curve=item_6)
division = Division(A=len, B=sampling_distance)
division_2 = Division(A=dist, B=stepover_distance)
addition = Addition(A=pdecon.ZComponent, B=safe_z)
neg = Negative(Value=len_2)

# ---- group: Milling bit sample points
neg_2 = Negative(Value=miling_bit_diameter)
multiplication_2 = Multiplication(A=miling_bit_diameter, B=0.5)
xy = XYPlane(Origin=Point(0, 0, 0))
xz_2 = XZPlane(Origin=Point(0, 0, 0))
dom = ConstructDomain(DomainStart=neg_2, DomainEnd=miling_bit_diameter)
division_3 = Division(A=miling_bit_diameter, B=mill_bit_sample_resolution)
sph = Sphere(Base=xz_2, Radius=multiplication_2)
planesrf = PlaneSurface(Plane=xy, XSize=dom, YSize=dom)
split = SplitBrep(Brep=sph, Cutter=planesrf)
pt = ConstructPoint(XCoordinate=0, YCoordinate=0, ZCoordinate=0)
X = UnitX(Factor=1)
Y = UnitY(Factor=1)
item_7 = ListItem(List=split, Index=1, Wrap=True)
sec = BrepPlane(Brep=sph, Plane=xy)  # -> Curves, Points
contour = Contour(Shape=item_7, Point=pt, Direction=X, Distance=division_3)
contour_2 = Contour(Shape=item_7, Point=pt, Direction=Y, Distance=division_3)
divide = DivideCurve(Curve=sec.Curves, Count=mill_bit_sample_resolution, Kinks=False)  # -> Points, Tangents, Parameters
ccx = CurveCurve(CurveA=flatten(contour), CurveB=contour_2)  # -> Points, ParamsA, ParamsB
flatten = FlattenTree(Tree=[ccx.Points, divide.Points], Path="{0}")

# ----
divide_2 = DivideCurve(Curve=item, Count=division, Kinks=False)  # -> Points, Tangents, Parameters
series = Series(Start=0, Step=stepover_distance, Count=division_2)
safe_z_2 = Number(addition)
Z = UnitZ(Factor=flatten(neg))
Y_2 = UnitY(Factor=series)
move = Move(Geometry=divide_2.Points, Motion=Z)  # -> Geometry, Transform
ln = Line(StartPoint=divide_2.Points, EndPoint=move.Geometry)
move_2 = Move(Geometry=ln, Motion=graft(Y_2))  # -> Geometry, Transform; disabled
move_3 = Move(Geometry=divide_2.Points, Motion=graft(Y_2))  # -> Geometry, Transform
blx = BrepLine(Brep=mesh, Line=move_2.Geometry, LimitToFirst=False)  # -> Curves, Points
meshray = MeshRay(Mesh=mesh, Point=move_3.Geometry, Direction=Z)  # -> Point, Hit
item_8 = ListItem(List=meshray.Point, Index=0, Wrap=True)
neg_3 = Negative(Value=multiplication_2)
simplify = SimplifyTree(Tree=meshray.Point, Front=False)
Z_2 = UnitZ(Factor=neg_3)
pshift = ShiftPaths(Data=simplify, Offset=-1)
move_4 = Move(Geometry=pt, Motion=Z_2)  # -> Geometry, Transform
pline = PolyLine(Vertices=simplify, Closed=False)
pt_2 = Point(move_4.Geometry)
clean = CleanTree(Tree=pline, CleanInvalid=True, CleanEmpty=False)
end = EndPoints(Curve=clean)  # -> Start, End
cp = PlaneClosestPoint(Point=end.Start, Plane=planar.Plane)  # -> Point, UVPoint, Distance
cp_2 = PlaneClosestPoint(Point=end.End, Plane=planar.Plane)  # -> Point, UVPoint, Distance
ln_2 = Line(StartPoint=cp.Point, EndPoint=end.Start)
ln_3 = Line(StartPoint=end.End, EndPoint=cp_2.Point)
join = JoinCurves(Curves=flatten([clean, ln_2, ln_3]), Preserve=False)
volume = Volume(Geometry=bbox.Box)  # -> Volume, Centroid
scale_2 = Scale(Geometry=bbox.Box, Center=volume.Centroid, Factor=10)  # -> Geometry, Transform
debrep_2 = DeconstructBrep(Brep=scale_2.Geometry)  # -> Faces, Edges, Vertices
xy_2 = XYPlane(Origin=Point(0, 0, 0))
item_9 = ListItem(List=debrep_2.Faces, Index=Slider(4, range=0..10), Wrap=True)
max_depth_plane = Plane(xy_2)
planar_2 = IsPlanar(Surface=item_9, Interior=True)  # -> Planar, Plane
cp_3 = PlaneClosestPoint(Point=planar_2.Plane, Plane=max_depth_plane)  # -> Point, UVPoint, Distance
Z_3 = UnitZ(Factor=cp_3.Distance)
multiplication_3 = Multiplication(A=stepover_distance, B=deifintion_fade_factor)
project = Project(Geometry=defintion_regions, Plane=max_depth_plane)  # -> Geometry, Transform
move_5 = Move(Geometry=scale_2.Geometry, Motion=Z_3)  # -> Geometry, Transform
offset = Offset(Curve=project.Geometry, Distance=multiplication_3, Plane=PlaneXY(0, 0, 0), Corners=1)
outer_defintion_regions = Curve(flatten(offset))
inner_defintion_regions = Curve(project.Geometry)
sliced_curves = Curve(join)
Z_4 = UnitZ(Factor=-100)
dispatch = Dispatch(List=flatten(sliced_curves), DispatchPattern=[True, True, True, False])  # -> ListA, ListB
extr = Extrude(Base=inner_defintion_regions, Direction=Z_4)
extr_2 = Extrude(Base=outer_defintion_regions, Direction=Z_4)
dispatch_2 = Dispatch(List=dispatch.ListA, DispatchPattern=[False, True, False])  # -> ListA, ListB
cap = CapHoles(Brep=extr_2)
cap_2 = CapHoles(Brep=extr)
trim = TrimWithBreps(Curve=dispatch_2.ListA, Brep=cap)  # -> Inside, Outside
trim_2 = TrimWithBreps(Curve=dispatch_2.ListB, Brep=cap_2)  # -> Inside, Outside
high_def_curves = Curve(trim.Inside)
main_curves = Curve(dispatch.ListB)
multiplication_4 = Multiplication(A=curve_merge_length_factor, B=2)
weave = Weave(Pattern=[0, 1], Stream0=dispatch_2.ListA, Stream1=dispatch.ListB, NullGaps=False)
high_def_curves_2 = Curve(trim_2.Inside)
crv = Curve(weave)
multiplication_5 = Multiplication(A=stepover_distance, B=multiplication_4)
multiplication_6 = Multiplication(A=stepover_distance, B=curve_merge_length_factor)
multiplication_7 = Multiplication(A=multiplication_5, B=curve_merge_bulge_factor)
ext = ExtendCurve(Curve=high_def_curves, Type=0, Start=multiplication_5, End=multiplication_5)
multiplication_8 = Multiplication(A=multiplication_6, B=curve_merge_bulge_factor)
ext_2 = ExtendCurve(Curve=high_def_curves_2, Type=0, Start=multiplication_6, End=multiplication_6)
end_2 = EndPoints(Curve=ext)  # -> Start, End
end_3 = EndPoints(Curve=high_def_curves)  # -> Start, End
end_4 = EndPoints(Curve=high_def_curves_2)  # -> Start, End
end_5 = EndPoints(Curve=ext_2)  # -> Start, End
crv_cp = CurveClosestPoint(Point=end_2.End, Curve=graft(main_curves))  # -> Point, Parameter, Distance
crv_cp_2 = CurveClosestPoint(Point=end_2.Start, Curve=graft(main_curves))  # -> Point, Parameter, Distance
crv_cp_3 = CurveClosestPoint(Point=end_5.End, Curve=graft(crv))  # -> Point, Parameter, Distance
crv_cp_4 = CurveClosestPoint(Point=end_5.Start, Curve=graft(crv))  # -> Point, Parameter, Distance
cp_4 = ClosestPoint(Point=end_2.Start, Cloud=crv_cp_2.Point)  # -> ClosestPoint, CPIndex, Distance
cp_5 = ClosestPoint(Point=end_2.End, Cloud=crv_cp.Point)  # -> ClosestPoint, CPIndex, Distance
cp_6 = ClosestPoint(Point=end_5.End, Cloud=crv_cp_3.Point)  # -> ClosestPoint, CPIndex, Distance
cp_7 = ClosestPoint(Point=end_5.Start, Cloud=crv_cp_4.Point)  # -> ClosestPoint, CPIndex, Distance
crv_cp_5 = CurveClosestPoint(Point=end_3.Start, Curve=high_def_curves)  # -> Point, Parameter, Distance
crv_cp_6 = CurveClosestPoint(Point=end_3.End, Curve=high_def_curves)  # -> Point, Parameter, Distance
crv_cp_7 = CurveClosestPoint(Point=end_4.Start, Curve=high_def_curves_2)  # -> Point, Parameter, Distance
crv_cp_8 = CurveClosestPoint(Point=end_4.End, Curve=high_def_curves_2)  # -> Point, Parameter, Distance
eval = EvaluateCurve(Curve=high_def_curves, Parameter=crv_cp_5.Parameter)  # -> Point, Tangent, Angle
eval_2 = EvaluateCurve(Curve=high_def_curves, Parameter=crv_cp_6.Parameter)  # -> Point, Tangent, Angle
eval_3 = EvaluateCurve(Curve=high_def_curves_2, Parameter=crv_cp_7.Parameter)  # -> Point, Tangent, Angle
eval_4 = EvaluateCurve(Curve=high_def_curves_2, Parameter=crv_cp_8.Parameter)  # -> Point, Tangent, Angle
pt_3 = Point(end_3.Start)
pt_4 = Point(cp_4.ClosestPoint)
pt_5 = Point(end_3.End)
amp = Amplitude(Vector=eval.Tangent, Amplitude=multiplication_7)
pt_6 = Point(cp_5.ClosestPoint)
amp_2 = Amplitude(Vector=eval_2.Tangent, Amplitude=multiplication_7)
rev = Reverse(Vector=amp)
rev_2 = Reverse(Vector=amp_2)
pt_7 = Point(end_4.Start)
pt_8 = Point(cp_7.ClosestPoint)
pt_9 = Point(end_4.End)
amp_3 = Amplitude(Vector=eval_3.Tangent, Amplitude=multiplication_8)
amp_4 = Amplitude(Vector=eval_4.Tangent, Amplitude=multiplication_8)
pt_10 = Point(cp_6.ClosestPoint)
rev_3 = Reverse(Vector=amp_3)
rev_4 = Reverse(Vector=amp_4)
bzspan = BezierSpan(StartPoint=pt_3, StartTangent=rev, EndPoint=pt_4, EndTangent=amp)  # -> Curve, Length, Domain
bzspan_2 = BezierSpan(StartPoint=pt_5, StartTangent=amp_2, EndPoint=pt_6, EndTangent=rev_2)  # -> Curve, Length, Domain
bzspan_3 = BezierSpan(StartPoint=pt_7, StartTangent=rev_3, EndPoint=pt_8, EndTangent=amp_3)  # -> Curve, Length, Domain
bzspan_4 = BezierSpan(StartPoint=pt_9, StartTangent=amp_4, EndPoint=pt_10, EndTangent=rev_4)  # -> Curve, Length, Domain
topoly = CurveToPolyline(Curve=[bzspan.Curve, bzspan_2.Curve], ToleranceDistance=multiplication, ToleranceAngle=0)  # -> Polyline, Segments
topoly_2 = CurveToPolyline(Curve=[bzspan_4.Curve, bzspan_3.Curve], ToleranceDistance=multiplication, ToleranceAngle=0)  # -> Polyline, Segments
join_2 = JoinCurves(Curves=flatten([trim.Inside, topoly.Polyline]), Preserve=False)
join_3 = JoinCurves(Curves=flatten([high_def_curves_2, topoly_2.Polyline]), Preserve=False)
medium_def_curves = Curve(join_2)
high_def_curves_3 = Curve(join_3)
main_curves_2 = Curve(main_curves)
dispatch_3 = Dispatch(List=high_def_curves_3, DispatchPattern=[True, False])  # -> ListA, ListB
dispatch_4 = Dispatch(List=medium_def_curves, DispatchPattern=[True, False])  # -> ListA, ListB
dispatch_5 = Dispatch(List=main_curves_2, DispatchPattern=[True, False])  # -> ListA, ListB
flip = FlipCurve(Curve=dispatch_4.ListB)  # -> Curve, Flag
flip_2 = FlipCurve(Curve=dispatch_3.ListB)  # -> Curve, Flag
flip_3 = FlipCurve(Curve=dispatch_5.ListB)  # -> Curve, Flag
weave_2 = Weave(Pattern=[0, 1], Stream0=dispatch_4.ListA, Stream1=flip.Curve, NullGaps=False)
weave_3 = Weave(Pattern=[0, 1], Stream0=dispatch_3.ListA, Stream1=flip_2.Curve, NullGaps=False)
weave_4 = Weave(Pattern=[0, 1], Stream0=dispatch_5.ListA, Stream1=flip_3.Curve, NullGaps=False)
num = Number(miling_bit_diameter)
multiplication_9 = Multiplication(A=num, B=5)
cp_8 = ControlPoints(Curve=weave_3)  # -> Points, Weights, Knots
cp_9 = ControlPoints(Curve=weave_2)  # -> Points, Weights, Knots
cp_10 = ControlPoints(Curve=weave_4)  # -> Points, Weights, Knots
pt_11 = Point(graft(flatten))
Z_5 = UnitZ(Factor=multiplication_9)

move_6 = Move(Geometry=cp_8.Points, Motion=Z_5)  # -> Geometry, Transform
vec2pt = Vector2Pt(PointA=pt_2, PointB=move_6.Geometry, Unitize=False)  # -> Vector, Length
move_7 = Move(Geometry=pt_11, Motion=flatten(vec2pt.Vector))  # -> Geometry, Transform
meshray_2 = MeshRay(Mesh=mesh, Point=move_7.Geometry, Direction=Z)  # -> Point, Hit
dist_2 = Distance(PointA=move_7.Geometry, PointB=meshray_2.Point)
flip_4 = FlipMatrix(Data=dist_2)
clean_2 = CleanTree(Tree=flip_4, CleanInvalid=True, CleanEmpty=False)
sort = SortList(Keys=clean_2)  # -> Keys, ValuesA
item_10 = ListItem(List=sort.Keys, Index=0, Wrap=True)
Z_6 = UnitZ(Factor=item_10)
rev_5 = Reverse(Vector=Z_6)
graft = GraftTree(Tree=rev_5, IncludeEmptyLists=True, IncludeNullItems=True)
graft_2 = GraftTree(Tree=move_6.Geometry, IncludeEmptyLists=True, IncludeNullItems=True)
move_8 = Move(Geometry=graft_2, Motion=graft)  # -> Geometry, Transform
clean_3 = CleanTree(Tree=move_8.Geometry, CleanInvalid=True, CleanEmpty=True)
pshift_2 = ShiftPaths(Data=clean_3, Offset=-1)
pline_2 = PolyLine(Vertices=pshift_2, Closed=False)
flatten_2 = FlattenTree(Tree=pline_2, Path="{0}")

move_9 = Move(Geometry=cp_9.Points, Motion=Z_5)  # -> Geometry, Transform
vec2pt_2 = Vector2Pt(PointA=pt_2, PointB=move_9.Geometry, Unitize=False)  # -> Vector, Length
move_10 = Move(Geometry=pt_11, Motion=flatten(vec2pt_2.Vector))  # -> Geometry, Transform
meshray_3 = MeshRay(Mesh=mesh, Point=move_10.Geometry, Direction=Z)  # -> Point, Hit
dist_3 = Distance(PointA=move_10.Geometry, PointB=meshray_3.Point)
flip_5 = FlipMatrix(Data=dist_3)
clean_4 = CleanTree(Tree=flip_5, CleanInvalid=True, CleanEmpty=False)
sort_2 = SortList(Keys=clean_4)  # -> Keys, ValuesA
item_11 = ListItem(List=sort_2.Keys, Index=0, Wrap=True)
Z_7 = UnitZ(Factor=item_11)
pt_12 = Point(move_9.Geometry)
rev_6 = Reverse(Vector=Z_7)
graft_3 = GraftTree(Tree=rev_6, IncludeEmptyLists=True, IncludeNullItems=True)
graft_4 = GraftTree(Tree=pt_12, IncludeEmptyLists=True, IncludeNullItems=True)
move_11 = Move(Geometry=graft_4, Motion=graft_3)  # -> Geometry, Transform
clean_5 = CleanTree(Tree=move_11.Geometry, CleanInvalid=True, CleanEmpty=True)
pshift_3 = ShiftPaths(Data=clean_5, Offset=-1)
pline_3 = PolyLine(Vertices=pshift_3, Closed=False)
flatten_3 = FlattenTree(Tree=pline_3, Path="{0}")

move_12 = Move(Geometry=cp_10.Points, Motion=Z_5)  # -> Geometry, Transform
vec2pt_3 = Vector2Pt(PointA=pt_2, PointB=move_12.Geometry, Unitize=False)  # -> Vector, Length
move_13 = Move(Geometry=pt_11, Motion=flatten(vec2pt_3.Vector))  # -> Geometry, Transform
meshray_4 = MeshRay(Mesh=mesh, Point=move_13.Geometry, Direction=Z)  # -> Point, Hit
dist_4 = Distance(PointA=move_13.Geometry, PointB=meshray_4.Point)
flip_6 = FlipMatrix(Data=dist_4)
clean_6 = CleanTree(Tree=flip_6, CleanInvalid=True, CleanEmpty=False)
sort_3 = SortList(Keys=clean_6)  # -> Keys, ValuesA
item_12 = ListItem(List=sort_3.Keys, Index=0, Wrap=True)
Z_8 = UnitZ(Factor=item_12)
rev_7 = Reverse(Vector=Z_8)
graft_5 = GraftTree(Tree=rev_7, IncludeEmptyLists=True, IncludeNullItems=True)
graft_6 = GraftTree(Tree=move_12.Geometry, IncludeEmptyLists=True, IncludeNullItems=True)
move_14 = Move(Geometry=graft_6, Motion=graft_5)  # -> Geometry, Transform
clean_7 = CleanTree(Tree=move_14.Geometry, CleanInvalid=True, CleanEmpty=True)
pshift_4 = ShiftPaths(Data=clean_7, Offset=-1)
pline_4 = PolyLine(Vertices=flatten(pshift_4), Closed=False)
flatten_4 = FlattenTree(Tree=pline_4, Path="{0}")

crv_2 = Curve(flatten_3)
crv_3 = Curve(flatten_2)

divide_3 = DivideCurve(Curve=crv_2, Count=1, Kinks=False)  # -> Points, Tangents, Parameters
flatten_5 = FlattenTree(Tree=divide_3.Points, Path="{0}")
rev_8 = ReverseList(List=flatten_5)
cull_i = CullIndex(List=rev_8, Indices=0, Wrap=True)
shift = ShiftList(List=flatten_5, Shift=1, Wrap=False)
rev_9 = ReverseList(List=cull_i)
ln_4 = Line(StartPoint=shift, EndPoint=rev_9)
dispatch_6 = Dispatch(List=ln_4, DispatchPattern=[True, False])  # -> ListA, ListB
end_6 = EndPoints(Curve=dispatch_6.ListB)  # -> Start, End
end_7 = EndPoints(Curve=dispatch_6.ListB)  # -> Start, End
pdecon_2 = Deconstruct(Point=end_6.End)  # -> XComponent, YComponent, ZComponent
pdecon_3 = Deconstruct(Point=end_7.Start)  # -> XComponent, YComponent, ZComponent
pt_13 = ConstructPoint(XCoordinate=pdecon_3.XComponent, YCoordinate=pdecon_3.YComponent, ZCoordinate=safe_z_2)
pt_14 = ConstructPoint(XCoordinate=pdecon_2.XComponent, YCoordinate=pdecon_2.YComponent, ZCoordinate=safe_z_2)
ln_5 = Line(StartPoint=pt_13, EndPoint=pt_14)
ln_6 = Line(StartPoint=end_6.End, EndPoint=pt_14)
ln_7 = Line(StartPoint=pt_13, EndPoint=end_7.Start)
join_4 = JoinCurves(Curves=flatten([ln_7, ln_5, ln_6, crv_2]), Preserve=False)
end_8 = EndPoints(Curve=join_4)  # -> Start, End
end_point = Point(end_8.End)
start_point = Point(end_8.Start)
pdecon_4 = Deconstruct(Point=end_point)  # -> XComponent, YComponent, ZComponent
pdecon_5 = Deconstruct(Point=start_point)  # -> XComponent, YComponent, ZComponent
pt_15 = ConstructPoint(XCoordinate=pdecon_4.XComponent, YCoordinate=pdecon_4.YComponent, ZCoordinate=safe_z_2)
pt_16 = ConstructPoint(XCoordinate=pdecon_5.XComponent, YCoordinate=pdecon_5.YComponent, ZCoordinate=safe_z_2)
ln_8 = Line(StartPoint=end_point, EndPoint=pt_15)
ln_9 = Line(StartPoint=pt_16, EndPoint=start_point)
join_5 = JoinCurves(Curves=flatten([ln_8, ln_9, join_4]), Preserve=False)

divide_4 = DivideCurve(Curve=crv_3, Count=1, Kinks=False)  # -> Points, Tangents, Parameters
flatten_6 = FlattenTree(Tree=divide_4.Points, Path="{0}")
rev_10 = ReverseList(List=flatten_6)
cull_i_2 = CullIndex(List=rev_10, Indices=0, Wrap=True)
shift_2 = ShiftList(List=flatten_6, Shift=1, Wrap=False)
rev_11 = ReverseList(List=cull_i_2)
ln_10 = Line(StartPoint=shift_2, EndPoint=rev_11)
dispatch_7 = Dispatch(List=ln_10, DispatchPattern=[True, False])  # -> ListA, ListB
end_9 = EndPoints(Curve=dispatch_7.ListB)  # -> Start, End
end_10 = EndPoints(Curve=dispatch_7.ListB)  # -> Start, End
pdecon_6 = Deconstruct(Point=end_9.End)  # -> XComponent, YComponent, ZComponent
pdecon_7 = Deconstruct(Point=end_10.Start)  # -> XComponent, YComponent, ZComponent
pt_17 = ConstructPoint(XCoordinate=pdecon_7.XComponent, YCoordinate=pdecon_7.YComponent, ZCoordinate=safe_z_2)
pt_18 = ConstructPoint(XCoordinate=pdecon_6.XComponent, YCoordinate=pdecon_6.YComponent, ZCoordinate=safe_z_2)
ln_11 = Line(StartPoint=pt_17, EndPoint=pt_18)
ln_12 = Line(StartPoint=end_9.End, EndPoint=pt_18)
ln_13 = Line(StartPoint=pt_17, EndPoint=end_10.Start)
join_6 = JoinCurves(Curves=flatten([ln_13, ln_11, ln_12, crv_3]), Preserve=False)
end_11 = EndPoints(Curve=join_6)  # -> Start, End
end_point_2 = Point(end_11.End)
start_point_2 = Point(end_11.Start)
pdecon_8 = Deconstruct(Point=end_point_2)  # -> XComponent, YComponent, ZComponent
pdecon_9 = Deconstruct(Point=start_point_2)  # -> XComponent, YComponent, ZComponent
pt_19 = ConstructPoint(XCoordinate=pdecon_8.XComponent, YCoordinate=pdecon_8.YComponent, ZCoordinate=safe_z_2)
pt_20 = ConstructPoint(XCoordinate=pdecon_9.XComponent, YCoordinate=pdecon_9.YComponent, ZCoordinate=safe_z_2)
ln_14 = Line(StartPoint=end_point_2, EndPoint=pt_19)
ln_15 = Line(StartPoint=pt_20, EndPoint=start_point_2)
join_7 = JoinCurves(Curves=flatten([ln_14, ln_15, join_6]), Preserve=False)

crv_4 = Curve()
end_12 = EndPoints(Curve=crv_4)  # -> Start, End
rev_12 = ReverseList(List=flatten(end_12.End))
shift_3 = ShiftList(List=rev_12, Shift=1, Wrap=False)
shift_4 = ShiftList(List=flatten(end_12.Start), Shift=1, Wrap=False)
rev_13 = ReverseList(List=shift_3)
pdecon_10 = Deconstruct(Point=shift_4)  # -> XComponent, YComponent, ZComponent
pdecon_11 = Deconstruct(Point=rev_13)  # -> XComponent, YComponent, ZComponent
pt_21 = ConstructPoint(XCoordinate=pdecon_10.XComponent, YCoordinate=pdecon_10.YComponent, ZCoordinate=safe_z_2)
pt_22 = ConstructPoint(XCoordinate=pdecon_11.XComponent, YCoordinate=pdecon_11.YComponent, ZCoordinate=safe_z_2)
ln_16 = Line(StartPoint=rev_13, EndPoint=pt_22)
ln_17 = Line(StartPoint=pt_21, EndPoint=pt_22)
ln_18 = Line(StartPoint=pt_21, EndPoint=shift_4)

end_13 = EndPoints(Curve=flatten_4)  # -> Start, End
end_point_3 = Point(end_13.End)
start_point_3 = Point(end_13.Start)
pdecon_12 = Deconstruct(Point=end_point_3)  # -> XComponent, YComponent, ZComponent
pdecon_13 = Deconstruct(Point=start_point_3)  # -> XComponent, YComponent, ZComponent
pt_23 = ConstructPoint(XCoordinate=pdecon_12.XComponent, YCoordinate=pdecon_12.YComponent, ZCoordinate=safe_z_2)
pt_24 = ConstructPoint(XCoordinate=pdecon_13.XComponent, YCoordinate=pdecon_13.YComponent, ZCoordinate=safe_z_2)
ln_19 = Line(StartPoint=end_point_3, EndPoint=pt_23)
ln_20 = Line(StartPoint=pt_24, EndPoint=start_point_3)
join_8 = JoinCurves(Curves=flatten([ln_19, ln_20, flatten_4]), Preserve=False)

join_9 = JoinCurves(Curves=flatten([crv_4, ln_18, ln_17, ln_16]), Preserve=False)
disc = Discontinuity(Curve=join_9, Level=1)  # -> Points, Parameters
cp_11 = ControlPoints(Curve=join_8)  # -> Points, Weights, Knots
cp_12 = ControlPoints(Curve=join_5)  # -> Points, Weights, Knots
cp_13 = ControlPoints(Curve=join_7)  # -> Points, Weights, Knots
merge = Merge(Data1=cp_11.Points, Data2=cp_12.Points, Data3=cp_13.Points)
pt_25 = Point(flatten(merge))
lng = ListLength(List=pt_25)
safe_z_3 = Slider(6, range=0..100)
safe_z_4 = Number(flatten(safe_z_2))
spindle_speed = Slider(18000, range=6000..18000)
m3 = Text("M3")
item_13 = ListItem(List=flatten(pt_25), Index=0, Wrap=True)
pdecon_14 = Deconstruct(Point=pt_25)  # -> XComponent, YComponent, ZComponent
move_speed_z = Slider(15, range=0..100)
move_speed_x_y = Slider(35, range=0..100)
dup = DuplicateData(Data=m3, Number=lng, Order=True)
pdecon_15 = Deconstruct(Point=item_13)  # -> XComponent, YComponent, ZComponent
flatten_7 = FlattenTree(Tree=pdecon_14.ZComponent, Path="{0}")
flatten_8 = FlattenTree(Tree=pdecon_14.YComponent, Path="{0}")
flatten_9 = FlattenTree(Tree=pdecon_14.XComponent, Path="{0}")
flatten_10 = FlattenTree(Tree=dup, Path="{0}")
sa = Text("SA")
tr = Text("TR")
so_1_1 = Text("SO,1,1")
jz = Text("JZ")
ms = Text("MS")
jz_2 = Text("JZ")
flatten_11 = FlattenTree(Tree=pdecon_15.XComponent, Path="{0}")
flatten_12 = FlattenTree(Tree=pdecon_15.YComponent, Path="{0}")
j3 = Text("J3")
graft_7 = GraftTree(Tree=flatten_10, IncludeEmptyLists=True, IncludeNullItems=True)
graft_8 = GraftTree(Tree=flatten_9, IncludeEmptyLists=True, IncludeNullItems=True)
graft_9 = GraftTree(Tree=flatten_8, IncludeEmptyLists=True, IncludeNullItems=True)
graft_10 = GraftTree(Tree=flatten_7, IncludeEmptyLists=True, IncludeNullItems=True)
round = Round(Number=spindle_speed)  # -> Nearest, Floor, Ceiling
so_1_0 = Text("SO,1,0")
jh = Text("JH")
join_10 = TextJoin(Text=[jz, safe_z_4], Join=",")
join_11 = TextJoin(Text=[ms, move_speed_x_y, move_speed_z], Join=",")
join_12 = TextJoin(Text=[jz_2, safe_z_4], Join=",")
join_13 = TextJoin(Text=[tr, round.Nearest], Join=",")
join_14 = TextJoin(Text=[j3, flatten_11, flatten_12, safe_z_4], Join=",")
join_15 = TextJoin(Text=[graft_7, graft_8, graft_9, graft_10], Join=",")
panel = Panel(sa)
panel_2 = Panel(join_13)
panel_3 = Panel(so_1_1)
panel_4 = Panel(join_10)
panel_5 = Panel(join_14)
panel_6 = Panel(join_11)
panel_7 = Panel(join_12)
panel_8 = Panel(join_15)
panel_9 = Panel(so_1_0)
panel_10 = Panel(jh)
panel_11 = Panel(join_12)
flatten_13 = FlattenTree(Tree=panel_8, Path="{0}")
shopbot_code = Data([panel, panel_3, panel_2, panel_4, panel_7, panel_5, panel_6, flatten_13, panel_11, panel_9, panel_10])
panel_12 = Panel(shopbot_code)
