# Grasshopper definition gh shopbot code from slice01.gh (Grasshopper 0.9.66)

xz = XZPlane(Origin=Point(0, 0, 0))
cyl = Cylinder(Base=xz, Radius=0.5, Length=Slider(1, range=0..1))
scale = Scale(Geometry=cyl, Center=Point(0, 0, 0), Factor=Slider(79, range=0..100))  # -> Geometry, Transform
sampling_distance = Slider(1, range=1..10)
stepover_distance = Slider(2, range=1..10)
safe_z = Slider(6, range=0..100)
brep = Brep(<brep referenced from the Rhino model>)
brep_2 = Brep(scale.Geometry)
bbox = BoundingBox(Content=brep_2, Plane=PlaneXY(0, 0, 0), UnionBox=True)  # -> Box, Box_2
debrep = DeconstructBrep(Brep=bbox.Box)  # -> Faces, Edges, Vertices
item = ListItem(List=debrep.Edges, Index=4, Wrap=True)
item_2 = ListItem(List=debrep.Vertices, Index=0, Wrap=True)
item_3 = ListItem(List=debrep.Vertices, Index=3, Wrap=True)
item_4 = ListItem(List=debrep.Vertices, Index=4, Wrap=True)
item_5 = ListItem(List=debrep.Faces, Index=4, Wrap=True)
len = Length(Curve=item)
item_6 = ListItem(List=debrep.Edges, Index=9, Wrap=True)
pdecon = Deconstruct(Point=item_4)  # -> XComponent, YComponent, ZComponent
dist = Distance(PointA=item_2, PointB=item_3)
planar = Planar(Curve=item_5)  # -> Planar, Plane, Deviation
len_2 = Length(Curve=item_6)
division = Division(A=len, B=sampling_distance)
division_2 = Division(A=dist, B=stepover_distance)
addition = Addition(A=pdecon.ZComponent, B=safe_z)
neg = Negative(Value=len_2)
divide = DivideCurve(Curve=item, Count=division, Kinks=False)  # -> Points, Tangents, Parameters
Z = UnitZ(Factor=flatten(neg))
series = Series(Start=0, Step=stepover_distance, Count=division_2)
Y = UnitY(Factor=series)
move = Move(Geometry=divide.Points, Motion=Z)  # -> Geometry, Transform
ln = Line(StartPoint=divide.Points, EndPoint=move.Geometry)
move_2 = Move(Geometry=ln, Motion=graft(Y))  # -> Geometry, Transform
blx = BrepLine(Brep=brep_2, Line=move_2.Geometry, LimitToFirst=False)  # -> Curves, Points
item_7 = ListItem(List=blx.Points, Index=0, Wrap=True)
simplify = SimplifyTree(Tree=item_7, Front=False)
pshift = ShiftPaths(Data=simplify, Offset=-1)
pline = PolyLine(Vertices=pshift, Closed=False)
end = EndPoints(Curve=pline)  # -> Start, End
cp = PlaneClosestPoint(Point=end.Start, Plane=planar.Plane)  # -> Point, UVPoint, Distance
cp_2 = PlaneClosestPoint(Point=end.End, Plane=planar.Plane)  # -> Point, UVPoint, Distance
ln_2 = Line(StartPoint=cp.Point, EndPoint=end.Start)
ln_3 = Line(StartPoint=end.End, EndPoint=cp_2.Point)
join = JoinCurves(Curves=flatten([pline, ln_2, ln_3]), Preserve=False)
end_2 = EndPoints(Curve=join)  # -> Start, End
rev = ReverseList(List=flatten(end_2.End))
shift = ShiftList(List=rev, Shift=1, Wrap=False)
shift_2 = ShiftList(List=flatten(end_2.Start), Shift=1, Wrap=False)
rev_2 = ReverseList(List=shift)
pdecon_2 = Deconstruct(Point=shift_2)  # -> XComponent, YComponent, ZComponent
pdecon_3 = Deconstruct(Point=rev_2)  # -> XComponent, YComponent, ZComponent
pt = ConstructPoint(XCoordinate=pdecon_2.XComponent, YCoordinate=pdecon_2.YComponent, ZCoordinate=addition)
pt_2 = ConstructPoint(XCoordinate=pdecon_3.XComponent, YCoordinate=pdecon_3.YComponent, ZCoordinate=addition)
ln_4 = Line(StartPoint=rev_2, EndPoint=pt_2)
ln_5 = Line(StartPoint=pt, EndPoint=pt_2)
ln_6 = Line(StartPoint=pt, EndPoint=shift_2)
join_2 = JoinCurves(Curves=flatten([join, ln_6, ln_5, ln_4]), Preserve=False)
sampling_resolution = Slider(3.179, range=0..10)
disc = Discontinuity(Curve=join_2, Level=1)  # -> Points, Parameters
crv = Curve(<curve referenced from the Rhino model>)
divlength = DivideLength(Curve=crv, Length=sampling_resolution)  # -> Points, Tangents, Parameters
pt_3 = Point(disc.Points)
lng = ListLength(List=pt_3)
safe_z_2 = Slider(6, range=0..100)
spindle_speed = Slider(18000, range=6000..18000)
m3 = Text("M3")
item_8 = ListItem(List=flatten(pt_3), Index=0, Wrap=True)
pdecon_4 = Deconstruct(Point=pt_3)  # -> XComponent, YComponent, ZComponent
move_speed_z = Slider(15, range=0..100)
move_speed_x_y = Slider(25, range=0..100)
dup = DuplicateData(Data=m3, Number=lng, Order=True)
pdecon_5 = Deconstruct(Point=item_8)  # -> XComponent, YComponent, ZComponent
flatten = FlattenTree(Tree=pdecon_4.ZComponent, Path="{0}")
flatten_2 = FlattenTree(Tree=pdecon_4.YComponent, Path="{0}")
flatten_3 = FlattenTree(Tree=pdecon_4.XComponent, Path="{0}")
flatten_4 = FlattenTree(Tree=dup, Path="{0}")
sa = Text("SA")
tr = Text("TR")
so_1_1 = Text("SO,1,1")
jz = Text("JZ")
ms = Text("MS")
jz_2 = Text("JZ")
j3 = Text("J3")
flatten_5 = FlattenTree(Tree=pdecon_5.XComponent, Path="{0}")
flatten_6 = FlattenTree(Tree=pdecon_5.YComponent, Path="{0}")
graft = GraftTree(Tree=flatten_4, IncludeEmptyLists=True, IncludeNullItems=True)
graft_2 = GraftTree(Tree=flatten_3, IncludeEmptyLists=True, IncludeNullItems=True)
graft_3 = GraftTree(Tree=flatten_2, IncludeEmptyLists=True, IncludeNullItems=True)
graft_4 = GraftTree(Tree=flatten, IncludeEmptyLists=True, IncludeNullItems=True)
round = Round(Number=spindle_speed)  # -> Nearest, Floor, Ceiling
so_1_0 = Text("SO,1,0")
jh = Text("JH")
join_3 = TextJoin(Text=[jz, safe_z_2], Join=",")
join_4 = TextJoin(Text=[ms, move_speed_x_y, move_speed_z], Join=",")
join_5 = TextJoin(Text=[jz_2, safe_z_2], Join=",")
join_6 = TextJoin(Text=[tr, round.Nearest], Join=",")
join_7 = TextJoin(Text=[j3, flatten_5, flatten_6, safe_z_2], Join=",")
join_8 = TextJoin(Text=[graft, graft_2, graft_3, graft_4], Join=",")
panel = Panel(sa)
panel_2 = Panel(join_6)
panel_3 = Panel(so_1_1)
panel_4 = Panel(join_3)
panel_5 = Panel(join_7)
panel_6 = Panel(join_4)
panel_7 = Panel(join_5)
panel_8 = Panel(join_8)
panel_9 = Panel(so_1_0)
panel_10 = Panel(join_5)
panel_11 = Panel(jh)
flatten_7 = FlattenTree(Tree=panel_8, Path="{0}")
shopbot_code = Data([panel, panel_3, panel_2, panel_4, panel_7, panel_5, panel_6, flatten_7, panel_10, panel_9, panel_11])
panel_12 = Panel(shopbot_code)
